# Grasshopper definition wrist rest.gh (Grasshopper 0.9.80)

top = Geometry(<curve referenced from the Rhino model>)
border = Surface(<surface referenced from the Rhino model>)
X = UnitX(Factor=Slider(162.069, range=0..200))
extr = Extrude(Base=top, Direction=X)
pop2d = Populate2D(Region=border, Count=Slider(101, range=3..200), Seed=Slider(55, range=20..100))
Z = UnitZ(Factor=Slider(-27.801, range=-100.001..0))
extr_2 = Extrude(Base=extr, Direction=Z)
voronoi = Voronoi(Points=pop2d, Boundary=border, BruteForceOverride=False)
area = Area(Geometry=voronoi)  # -> Area, Centroid
rint = RegionIntersection(CurvesA=voronoi, CurvesB=border)
thickness = Slider(0.9, range=0..1)
scale = Scale(Geometry=rint, Center=area.Centroid, Factor=thickness)  # -> Geometry, Transform
weave = Weave(Pattern=[0, 1], Stream0=graft(rint), Stream1=graft(scale.Geometry), NullGaps=False)
loft = Loft(Curves=weave, Options={Adjust=False, Closed=False, LoftEnds=0, LoftSimp=0, LoftType=0, Rebuild=10, Refit=0.01})
height = Slider(23, range=0..25)
Z_2 = UnitZ(Factor=height)
extr_3 = Extrude(Base=loft, Direction=Z_2)
sint = SolidIntersection(BrepsA=extr_3, BrepsB=extr_2)
